# Grasshopper definition ExportTest.gh (Grasshopper 1.0.7)
# plug-ins: Shachihoko

# ----
# モデル
number_slider = Slider(2.5, range=0..10)
number_slider_2 = Slider(10, range=0..10)
center_box = CenterBox(Base=PlaneXY(0, 0, 0), X=Slider(6, range=0..10), Y=number_slider, Z=number_slider_2)
construct_point = ConstructPoint(XCoordinate=0, YCoordinate=0, ZCoordinate=expr("-x", number_slider_2))
unit_z = UnitZ(Factor=1)
line_sdl = LineSDL(Start=construct_point, Direction=unit_z, Length=expr("x*2", number_slider_2))
mesh_box = MeshBox(Base=center_box, XCount=Slider(60, range=0..100), YCount=Slider(25, range=0..100), ZCount=Slider(60, range=0..100))
twist = Twist(Geometry=mesh_box, Axis=line_sdl, Angle=1.570796327, Infinite=False, Rigid=False)

# ----
# マテリアル
number_slider_3 = Slider(0, range=0..1)
materialparam = MaterialParam(
    XComponent=Slider(0, range=0..1),
    YComponent=number_slider_3,
    ZComponent=Slider(0, range=0..1),
    WComponent=0,
    ParamType=0)
materialparam_2 = MaterialParam(
    XComponent=Slider(0, range=0..1),
    YComponent=Slider(0, range=0..1),
    ZComponent=Slider(1, range=0..1),
    WComponent=Slider(0, range=0..1),
    ParamType=0)
materialparam_3 = MaterialParam(XComponent=Slider(1, range=0..1), YComponent=Slider(0.5, range=0..1), ZComponent=0, WComponent=0, ParamType=0)
material = Material(Emissive=materialparam, BaseColor=materialparam_2, MetallicRoughness=materialparam_3, ShaderType=0)

# ----
# 書き出し
button = Button()
export = Export(Mesh=twist, Material=material, FolderPath="C:\Users\ozuon\Desktop", FileName="model", Switch=button)
